# Grasshopper definition Blackberry.gh (Grasshopper 1.0.8)
# plug-ins: Pufferfish, GhPolyhedra, ExcelPlus, Pancake

boolean_toggle = BooleanToggle(True)

# ---- group: Reload Excel
trigger = Trigger(Interval=1000, TimerInterval=1000, Target=python_3_script)
python_3_script = Python3Script()  # -> out, a
# ---------- python_3_script: Python ----------
import datetime
a = datetime.datetime.now().time()
total_seconds = a.hour * 3600 + a.minute * 60 + a.second + a.microsecond/1e6
a = total_seconds
# ---------- end python_3_script ----------
modulus = Modulus(A=python_3_script.a, B=Slider(65, range=0..100))
smaller_than = SmallerThan(FirstNumber=modulus, SecondNumber=Slider(5, range=0..10))  # -> SmallerThan, OrEqualTo
panel = Panel(boolean_toggle)

# ---- group: Recent Geometry
ghpython_script = GhPythonScript(x="6.8.6")  # -> out, a
# ---------- ghpython_script: Python ----------
__author__ = "sunpa675"
__version__ = "2024.05.06"

import rhinoscriptsyntax as rs
if x:
    #a = 'D:\Rocky AP-6.2.2\DoE\DoE_Arrays.xlsx'
    a = 'D:\Rocky_Simulations\Rocky AP-' + str(x) + '\DoE\DoE_Arrays.xlsx'
# ---------- end ghpython_script ----------
open_workbook = OpenWorkbook(Filepath=ghpython_script.a, Activate=boolean_toggle)
deconstruct_workbook = DeconstructWorkbook(Workbook=open_workbook)  # -> Workbook, Worksheet
list_item = ListItem(List=deconstruct_workbook.Worksheet, Index=0, Wrap=True)
deconstruct_worksheet = DeconstructWorksheet(Worksheet=list_item)  # -> Worksheet, Range, Cell
sub_ranges = SubRanges(Range=deconstruct_worksheet.Range, ByColumn=Toggle(False))
list_item_2 = ListItem(List=sub_ranges, Index=0, Wrap=True)
deconstruct_range = DeconstructRange(Range=list_item_2, Active=False, Flip=True)  # -> Range, Cell, Address
list_item_3 = ListItem(List=deconstruct_range.Cell, Index=Slider(-1, range=-2..100), Wrap=True)
cell_content = CellContent(Cell=list_item_3)  # -> Cell, Location, Value, Format, Formula
panel_2 = Panel(cell_content.Value)

# ----
boolean_toggle_2 = BooleanToggle(True)
ghpython_script_2 = GhPythonScript(x="6.8.6")  # -> out, a; same code as ghpython_script
open_workbook_2 = OpenWorkbook(Filepath=ghpython_script_2.a, Activate=boolean_toggle)
deconstruct_workbook_2 = DeconstructWorkbook(Workbook=open_workbook_2)  # -> Workbook, Worksheet
list_item_4 = ListItem(List=deconstruct_workbook_2.Worksheet, Index=0, Wrap=True)
deconstruct_worksheet_2 = DeconstructWorksheet(Worksheet=list_item_4)  # -> Worksheet, Range, Cell
value_list = ValueList({"Hexa Steg D": "1", "C": "2", "Hexa Pore D": "3", "Hexa Pore Z": "4", "Penta Steg D": "5", "Penta Steg Z": "6", "Penta Spike D": "7", "Penta Spike Z": "8", "Penta Tip Z": "9"}, selected="C")
value_list_2 = ValueList({"B": "1", "Hexa Steg Z": "2", "Hexa Pore D": "3", "Hexa Pore Z": "4", "Penta Steg D": "5", "Penta Steg Z": "6", "Penta Spike D": "7", "Penta Spike Z": "8", "Penta Tip Z": "9"}, selected="B")
value_list_3 = ValueList({"B": "1", "C": "2", "D": "3", "E": "4", "F": "5", "G": "6", "H": "7", "I": "8", "J": "9"}, selected="D")
value_list_4 = ValueList({"B": "1", "C": "2", "D": "3", "E": "4", "F": "5", "G": "6", "H": "7", "I": "8", "J": "9"}, selected="F")
value_list_5 = ValueList({"B": "1", "C": "2", "D": "3", "E": "4", "F": "5", "G": "6", "H": "7", "I": "8", "J": "9"}, selected="E")
sub_ranges_2 = SubRanges(Range=deconstruct_worksheet_2.Range, ByColumn=False)
list_item_5 = ListItem(List=sub_ranges_2, Index=Slider(0, range=0..100), Wrap=True)
deconstruct_range_2 = DeconstructRange(Range=list_item_5, Active=False, Flip=True)  # -> Range, Cell, Address
list_item_6 = ListItem(List=deconstruct_range_2.Cell, Index=Slider(1, range=0..10), Wrap=True)
cell_content_2 = CellContent(Cell=list_item_6)  # -> Cell, Location, Value, Format, Formula
list_item_7 = ListItem(List=sub_ranges_2, Index=value_list_2, Wrap=True)
list_item_8 = ListItem(List=sub_ranges_2, Index=value_list, Wrap=True)
list_item_9 = ListItem(List=sub_ranges_2, Index=value_list_3, Wrap=True)
list_item_10 = ListItem(List=sub_ranges_2, Index=value_list_4, Wrap=True)
list_item_11 = ListItem(List=sub_ranges_2, Index=value_list_5, Wrap=True)
deconstruct_range_3 = DeconstructRange(Range=list_item_9, Active=False, Flip=True)  # -> Range, Cell, Address
deconstruct_range_4 = DeconstructRange(Range=list_item_10, Active=False, Flip=True)  # -> Range, Cell, Address
deconstruct_range_5 = DeconstructRange(Range=list_item_7, Active=False, Flip=True)  # -> Range, Cell, Address
deconstruct_range_6 = DeconstructRange(Range=list_item_11, Active=False, Flip=True)  # -> Range, Cell, Address
deconstruct_range_7 = DeconstructRange(Range=list_item_8, Active=False, Flip=True)  # -> Range, Cell, Address
list_item_12 = ListItem(List=deconstruct_range_5.Cell, Index=cell_content.Value, Wrap=True)
list_item_13 = ListItem(List=deconstruct_range_7.Cell, Index=cell_content.Value, Wrap=True)
list_item_14 = ListItem(List=deconstruct_range_3.Cell, Index=cell_content.Value, Wrap=True)
list_item_15 = ListItem(List=deconstruct_range_4.Cell, Index=cell_content.Value, Wrap=True)
list_item_16 = ListItem(List=deconstruct_range_6.Cell, Index=cell_content.Value, Wrap=True)
cell_content_3 = CellContent(Cell=list_item_12)  # -> Cell, Location, flatten(Value), Format, Formula
cell_content_4 = CellContent(Cell=list_item_13)  # -> Cell, Location, flatten(Value), Format, Formula
cell_content_5 = CellContent(Cell=list_item_14)  # -> Cell, Location, flatten(Value), Format, Formula
cell_content_6 = CellContent(Cell=list_item_15)  # -> Cell, Location, Value, Format, Formula
cell_content_7 = CellContent(Cell=list_item_16)  # -> Cell, Location, flatten(Value), Format, Formula

round = Round(Number=cell_content_5.Value)  # -> Nearest, Floor, Ceiling

polyhedra_categories = PolyhedraCategories()
panel_3 = Panel(polyhedra_categories)
list_item_17 = ListItem(List=panel_3, Index=Slider(2, range=1..41), Wrap=True)
polyhedra_names = PolyhedraNames(Category=list_item_17)
number_slider = Slider(10, range=0..29)
panel_4 = Panel(polyhedra_names)
polyhedra_categories_2 = PolyhedraCategories()
list_item_18 = ListItem(List=panel_4, Index=round.Nearest, Wrap=True)
number_slider_2 = Slider(4.96, range=4..5)
panel_5 = Panel(polyhedra_categories_2)
list_item_19 = ListItem(List=panel_5, Index=Slider(9, range=1..41), Wrap=True)
polyhedron = Polyhedron(Name=list_item_18, Plane=PlaneXY(0, 0, 0), Scale=cell_content_3.Value)  # -> Curves, Meshes, Solid
construct_domain = ConstructDomain(DomainStart="0", DomainEnd="50")
polyhedra_names_2 = PolyhedraNames(Category=list_item_19)
panel_6 = Panel("Icosahedron")
panel_7 = Panel(polyhedra_names_2)
range = Range(Domain=construct_domain, Steps="5")
unit_x = UnitX(Factor=range)
brep_join = BrepJoin(Breps=polyhedron.Curves)  # -> Breps, Closed
list_item_20 = ListItem(List=panel_7, Index=Slider(0, range=0..29), Wrap=True)
move = Move(Geometry=brep_join.Breps, Motion=unit_x)  # -> Geometry, Transform
polyhedron_2 = Polyhedron(Name=list_item_20, Plane=PlaneXY(0, 0, 0), Scale=Slider(10, range=1..100))  # -> Curves, Meshes, Solid
merge = Merge(Data2=move.Geometry)
number_slider_3 = Slider(1, range=0..10)
morphtomesh = MorphToMesh(Geometry=merge, Mesh=polyhedron_2.Meshes, Offsets=cell_content_4.Value)  # -> flatten(Geometry), ReferencePolygons
solid_union = SolidUnion(Breps=morphtomesh.Geometry)
list_item_21 = ListItem(List=solid_union, Index=Slider(0, range=0..1), Wrap=True)

# ---- group: Export
brep_geometry = Brep(list_item_21)
ghpython_script_3 = GhPythonScript(z=cell_content_2.Value, x="6.8.6", y=cell_content.Value)  # -> out, a
# ---------- ghpython_script_3: Python ----------
__author__ = "sunpa675"
__version__ = "2024.03.14"

import Rhino as rc
a = 'D:\Rocky_Simulations\Rocky AP-' + str(x) + '\Geometrien\Carrier\\' + str(int(y)) + '.stl'
# ---------- end ghpython_script_3 ----------
settings_custom = SettingsCustom(
    StitchSeams=True,
    SimplePlanes=False,
    Refine=True,
    MinCount=Slider(0, range=0..100),
    MaxCount=Slider(22, range=0..100),
    AspectRatio=20,
    MaxDistance=0,
    MaxAngle=20,
    MinEdge=Slider(0, range=0..100),
    MaxEdge=0)
mesh_brep = MeshBrep(Brep=brep_geometry, Settings=settings_custom)
export_stl = ExportSTL(
    Mesh=mesh_brep,
    Relocate=Toggle(True),
    SavePath=ghpython_script_3.a,
    SaveAsBinaryFile=Toggle(True),
    SaveNow=Toggle(True),
    LastSaveLocalization="neutral,N")
is_mesh_closed = IsMeshClosed(Mesh=mesh_brep)

# ---- group: Writer
bounding_box = BoundingBox(Content=mesh_brep, Plane=PlaneXY(0, 0, 0))  # -> Box, Box_2
box_corners = BoxCorners(Box=bounding_box.Box)  # -> CornerA, CornerB, CornerC, CornerD, CornerE, CornerF, CornerG, CornerH
volume = Volume(Geometry=mesh_brep)  # -> Volume, Centroid
line = Line(StartPoint=box_corners.CornerA, EndPoint=box_corners.CornerB)
vector_length = VectorLength(Vector=line)
panel_8 = Panel("D:\Rocky_Simulations\Rocky AP-")
boolean_toggle_3 = BooleanToggle(True)
ghpython_script_4 = GhPythonScript(x=panel_8, z="\Geometrien\Carrier\", y="6.8.6", u="\", v="Carrier_Parameter.xlsx")  # -> out, a
# ---------- ghpython_script_4: Python ----------
__author__ = "sunpa675"
__version__ = "2024.07.22"

import rhinoscriptsyntax as rs


a = x + y + z + u + v
# ---------- end ghpython_script_4 ----------
open_workbook_3 = OpenWorkbook(Filepath=ghpython_script_4.a, Activate=boolean_toggle)
deconstruct_workbook_3 = DeconstructWorkbook(Workbook=open_workbook_3)  # -> Workbook, Worksheet
deconstruct_worksheet_3 = DeconstructWorksheet(Worksheet=deconstruct_workbook_3.Worksheet)  # -> Worksheet, Range, Cell
addition = Addition(A=cell_content.Value, B=Slider(1, range=0..1))
ghpython_script_5 = GhPythonScript(x=cell_content.Value)  # -> out, a
# ---------- ghpython_script_5: Python ----------
__author__ = "sunpa675"
__version__ = "2024.07.22"

import rhinoscriptsyntax as rs
x = int(x)
a = 'C' + str(int(x+1))
# ---------- end ghpython_script_5 ----------
ghpython_script_6 = GhPythonScript(x=cell_content.Value)  # -> out, a
# ---------- ghpython_script_6: Python ----------
__author__ = "sunpa675"
__version__ = "2024.07.22"

import rhinoscriptsyntax as rs
x = int(x)
a = 'A' + str(int(x+1))
# ---------- end ghpython_script_6 ----------
ghpython_script_7 = GhPythonScript(x=cell_content.Value)  # -> out, a
# ---------- ghpython_script_7: Python ----------
__author__ = "sunpa675"
__version__ = "2024.07.22"

import rhinoscriptsyntax as rs

a = 'B' + str(int(int(x)+1))
# ---------- end ghpython_script_7 ----------
ghpython_script_8 = GhPythonScript(x=panel_8, y="6.8.6", z="\Geometrien\Carrier\")  # -> out, a
# ---------- ghpython_script_8: Python ----------
__author__ = "sunpa675"
__version__ = "2024.07.22"

import rhinoscriptsyntax as rs

a = x + y + z
# ---------- end ghpython_script_8 ----------
cell_content_8 = CellContent(CellLocation=ghpython_script_6.a, Value=cell_content.Value)  # -> Cell, Location, Value, Format, Formula
cell_content_9 = CellContent(CellLocation=ghpython_script_5.a, Value=vector_length)  # -> Cell, Location, Value, Format, Formula
cell_content_10 = CellContent(CellLocation=ghpython_script_7.a, Value=volume.Volume)  # -> Cell, Location, Value, Format, Formula
merge_2 = Merge(Data1=cell_content_10.Cell, Data2=cell_content_8.Cell, Data3=cell_content_9.Cell)
panel_9 = Panel(ghpython_script_8.a)
construct_range = ConstructRange(Cells=flatten(merge_2))
construct_worksheet = ConstructWorksheet(Worksheet=deconstruct_worksheet_3.Worksheet, Range=construct_range)
boolean_toggle_4 = BooleanToggle(True)
construct_workbook = ConstructWorkbook(Worksheet=construct_worksheet)
save_workbook = SaveWorkbook(
    Workbook=construct_workbook,
    FolderPath=panel_9,
    FileName="Carrier_Parameter.xlsx",
    Extensions=0,
    Activate=boolean_toggle)  # -> Workbook, FilePath

# ----
E = Number(cell_content_7.Value)
F = Number(cell_content_6.Value)
B = Number(cell_content_3.Value)
D = Number(cell_content_5.Value)
number_slider_4 = Slider(2, range=1..3)
C = Number(cell_content_4.Value)
