# Grasshopper definition Grooveball.gh (Grasshopper 1.0.8)
# plug-ins: Pufferfish, ExcelPlus, Pancake

boolean_toggle = BooleanToggle(True)

# ---- group: Reload Excel
trigger = Trigger(Interval=1000, TimerInterval=1000, Target=python_3_script)
python_3_script = Python3Script()  # -> out, a
# ---------- python_3_script: Python ----------
import datetime
a = datetime.datetime.now().time()
total_seconds = a.hour * 3600 + a.minute * 60 + a.second + a.microsecond/1e6
a = total_seconds
# ---------- end python_3_script ----------
modulus = Modulus(A=python_3_script.a, B=Slider(65, range=0..100))
smaller_than = SmallerThan(FirstNumber=modulus, SecondNumber=Slider(5, range=0..10))  # -> SmallerThan, OrEqualTo
panel = Panel(boolean_toggle)

# ----
number_slider = Slider(1, range=1..3)

boolean_toggle_2 = BooleanToggle(True)
ghpython_script = GhPythonScript(x="6.8.3")  # -> out, a
# ---------- ghpython_script: Python ----------
__author__ = "sunpa675"
__version__ = "2024.05.06"

import rhinoscriptsyntax as rs
if x:
    #a = 'D:\Rocky AP-6.2.2\DoE\DoE_Arrays.xlsx'
    a = 'D:\Rocky_Simulations\Rocky AP-' + str(x) + '\DoE\DoE_Arrays.xlsx'
# ---------- end ghpython_script ----------
open_workbook = OpenWorkbook(Filepath=ghpython_script.a, Activate=boolean_toggle)
deconstruct_workbook = DeconstructWorkbook(Workbook=open_workbook)  # -> Workbook, Worksheet
list_item = ListItem(List=deconstruct_workbook.Worksheet, Index=0, Wrap=True)
deconstruct_worksheet = DeconstructWorksheet(Worksheet=list_item)  # -> Worksheet, Range, Cell
value_list = ValueList({"Hexa Steg D": "1", "C": "2", "Hexa Pore D": "3", "Hexa Pore Z": "4", "Penta Steg D": "5", "Penta Steg Z": "6", "Penta Spike D": "7", "Penta Spike Z": "8", "Penta Tip Z": "9"}, selected="C")
value_list_2 = ValueList({"B": "1", "Hexa Steg Z": "2", "Hexa Pore D": "3", "Hexa Pore Z": "4", "Penta Steg D": "5", "Penta Steg Z": "6", "Penta Spike D": "7", "Penta Spike Z": "8", "Penta Tip Z": "9"}, selected="B")
value_list_3 = ValueList({"B": "1", "C": "2", "D": "3", "E": "4", "F": "5", "G": "6", "H": "7", "I": "8", "J": "9"}, selected="D")
value_list_4 = ValueList({"B": "1", "C": "2", "D": "3", "E": "4", "F": "5", "G": "6", "H": "7", "I": "8", "J": "9"}, selected="F")
value_list_5 = ValueList({"B": "1", "C": "2", "D": "3", "E": "4", "F": "5", "G": "6", "H": "7", "I": "8", "J": "9"}, selected="E")
sub_ranges = SubRanges(Range=deconstruct_worksheet.Range, ByColumn=False)
list_item_2 = ListItem(List=sub_ranges, Index=Slider(0, range=0..100), Wrap=True)
deconstruct_range = DeconstructRange(Range=list_item_2, Active=False, Flip=True)  # -> Range, Cell, Address
list_item_3 = ListItem(List=deconstruct_range.Cell, Index=Slider(1, range=0..10), Wrap=True)
cell_content = CellContent(Cell=list_item_3)  # -> Cell, Location, Value, Format, Formula
list_item_4 = ListItem(List=sub_ranges, Index=value_list_2, Wrap=True)
list_item_5 = ListItem(List=sub_ranges, Index=value_list, Wrap=True)
list_item_6 = ListItem(List=sub_ranges, Index=value_list_3, Wrap=True)
list_item_7 = ListItem(List=sub_ranges, Index=value_list_4, Wrap=True)
list_item_8 = ListItem(List=sub_ranges, Index=value_list_5, Wrap=True)
deconstruct_range_2 = DeconstructRange(Range=list_item_6, Active=False, Flip=True)  # -> Range, Cell, Address
deconstruct_range_3 = DeconstructRange(Range=list_item_7, Active=False, Flip=True)  # -> Range, Cell, Address
deconstruct_range_4 = DeconstructRange(Range=list_item_4, Active=False, Flip=True)  # -> Range, Cell, Address
deconstruct_range_5 = DeconstructRange(Range=list_item_8, Active=False, Flip=True)  # -> Range, Cell, Address
deconstruct_range_6 = DeconstructRange(Range=list_item_5, Active=False, Flip=True)  # -> Range, Cell, Address
list_item_9 = ListItem(List=deconstruct_range_4.Cell, Index=number_slider, Wrap=True)
list_item_10 = ListItem(List=deconstruct_range_6.Cell, Index=number_slider, Wrap=True)
list_item_11 = ListItem(List=deconstruct_range_2.Cell, Index=number_slider, Wrap=True)
list_item_12 = ListItem(List=deconstruct_range_3.Cell, Index=number_slider, Wrap=True)
list_item_13 = ListItem(List=deconstruct_range_5.Cell, Index=number_slider, Wrap=True)
cell_content_2 = CellContent(Cell=list_item_9)  # -> Cell, Location, flatten(Value), Format, Formula
cell_content_3 = CellContent(Cell=list_item_10)  # -> Cell, Location, flatten(Value), Format, Formula
cell_content_4 = CellContent(Cell=list_item_11)  # -> Cell, Location, flatten(Value), Format, Formula
cell_content_5 = CellContent(Cell=list_item_12)  # -> Cell, Location, flatten(Value), Format, Formula
cell_content_6 = CellContent(Cell=list_item_13)  # -> Cell, Location, flatten(Value), Format, Formula

number_slider_2 = Slider(0, range=0..100)
construct_point = ConstructPoint(XCoordinate=number_slider_2, YCoordinate=number_slider_2, ZCoordinate=number_slider_2)
number_slider_3 = Slider(-1, range=-1..1)
circle_cnr = CircleCNR(Center=construct_point, Normal=Vector(0, 0, 1), Radius=cell_content_3.Value)
radians = Radians(Degrees=cell_content_6.Value)
radians_2 = Radians(Degrees=cell_content_5.Value)
radians_3 = Radians(Degrees=cell_content_4.Value)
multiplication = Multiplication(A=radians_2, B=number_slider_3)
multiplication_2 = Multiplication(A=radians, B=number_slider_3)
addition = Addition(A=radians_3, B=multiplication_2)
addition_2 = Addition(A=radians_3, B=radians)
rotate = Rotate(Geometry=circle_cnr, Angle=multiplication, Plane=PlaneXY(0, 0, 0))  # -> Geometry, Transform
rotate_2 = Rotate(Geometry=circle_cnr, Angle=radians_2, Plane=PlaneXY(0, 0, 0))  # -> Geometry, Transform
number_slider_4 = Slider(0, range=0..100)
number_slider_5 = Slider(26, range=0..100)
circle_cnr_2 = CircleCNR(Center=construct_point, Normal=Vector(0, 0, 1), Radius=number_slider_5)
circle_cnr_3 = CircleCNR(Center=construct_point, Normal=Vector(0, 0, 1), Radius=number_slider_5)
rotate_3 = Rotate(Geometry=circle_cnr_3, Angle=addition_2, Plane=PlaneXY(0, 0, 0))  # -> Geometry, Transform
rotate_4 = Rotate(Geometry=circle_cnr_2, Angle=addition, Plane=PlaneXY(0, 0, 0))  # -> Geometry, Transform
divide_curve = DivideCurve(Curve=rotate_3.Geometry, Count=cell_content_2.Value, Kinks=False)  # -> Points, Tangents, Parameters
divide_curve_2 = DivideCurve(Curve=rotate_2.Geometry, Count=cell_content_2.Value, Kinks=False)  # -> Points, Tangents, Parameters
divide_curve_3 = DivideCurve(Curve=rotate_4.Geometry, Count=cell_content_2.Value, Kinks=False)  # -> Points, Tangents, Parameters
divide_curve_4 = DivideCurve(Curve=rotate.Geometry, Count=cell_content_2.Value, Kinks=False)  # -> Points, Tangents, Parameters
multiplication_3 = Multiplication(A=number_slider_5, B=Slider(-1, range=-1..1))
construct_point_2 = ConstructPoint(XCoordinate=number_slider_4, YCoordinate=number_slider_4, ZCoordinate=number_slider_5)
construct_point_3 = ConstructPoint(XCoordinate=number_slider_4, YCoordinate=number_slider_4, ZCoordinate=multiplication_3)
line = Line(StartPoint=divide_curve.Points, EndPoint=divide_curve_2.Points)
line_2 = Line(StartPoint=divide_curve_2.Points, EndPoint=divide_curve_3.Points)
line_3 = Line(StartPoint=construct_point_2, EndPoint=construct_point_3)
end_points = EndPoints(Curve=line_3)  # -> Start, End
arc_3pt = Arc3Pt(PointA=end_points.Start, PointB=divide_curve.Points, PointC=end_points.End)  # -> Arc, Plane, Radius
arc_3pt_2 = Arc3Pt(PointA=end_points.Start, PointB=divide_curve_3.Points, PointC=end_points.End)  # -> Arc, Plane, Radius
arc_3pt_3 = Arc3Pt(PointA=end_points.Start, PointB=divide_curve_2.Points, PointC=end_points.End)  # -> Arc, Plane, Radius
arc_3pt_4 = Arc3Pt(PointA=end_points.Start, PointB=divide_curve_4.Points, PointC=end_points.End)  # -> Arc, Plane, Radius
edge_surface = EdgeSurface(CurveA=arc_3pt.Arc, CurveB=arc_3pt_2.Arc)
edge_surface_2 = EdgeSurface(CurveA=arc_3pt_2.Arc, CurveB=arc_3pt_4.Arc)
edge_surface_3 = EdgeSurface(CurveA=arc_3pt.Arc, CurveB=arc_3pt_3.Arc)
edge_surface_4 = EdgeSurface(CurveA=arc_3pt_3.Arc, CurveB=arc_3pt_4.Arc)
sphere = Sphere(Base=PlaneXY(0, 0, 0), Radius=Slider(25, range=0..50))
merge = Merge(Data1=edge_surface, Data2=edge_surface_3, Data3=edge_surface_2, Data4=edge_surface_4)
volume = Volume(Geometry=sphere)  # -> Volume, Centroid
brep_join = BrepJoin(Breps=merge)  # -> Breps, Closed
solid_union = SolidUnion(Breps=sphere)
solid_difference = SolidDifference(BrepsA=solid_union, BrepsB=brep_join.Breps)
mesh_brep = MeshBrep(
    Brep=brep_join.Breps,
    Settings={GridMaxCount=0, GridMinCount=16, JaggedSeams=False, MaxEdgeLength=0, MinEdgeLength=0.0001, MinTolerance=0, Refine=True, RefineAngle=0, RelativeTolerance=0.65, SimplePlanes=True, Tolerance=0})
volume_2 = Volume(Geometry=solid_difference)  # -> Volume, Centroid
volume_3 = Volume(Geometry=solid_difference)  # -> Volume, Centroid
panel_2 = Panel(volume_3.Volume)

# ---- group: Export
brep_geometry = Brep(solid_difference)
ghpython_script_2 = GhPythonScript(z=cell_content.Value, x="6.8.3", y=number_slider)  # -> out, a
# ---------- ghpython_script_2: Python ----------
__author__ = "sunpa675"
__version__ = "2024.03.14"

import Rhino as rc
a = 'D:\Rocky_Simulations\Rocky AP-' + str(x) + '\Geometrien\Carrier\\' + str(int(y)) + '.stl'
# ---------- end ghpython_script_2 ----------
settings_custom = SettingsCustom(
    StitchSeams=True,
    SimplePlanes=False,
    Refine=True,
    MinCount=Slider(0, range=0..100),
    MaxCount=Slider(22, range=0..100),
    AspectRatio=20,
    MaxDistance=0,
    MaxAngle=20,
    MinEdge=Slider(0, range=0..100),
    MaxEdge=0)
mesh_brep_2 = MeshBrep(Brep=brep_geometry, Settings=settings_custom)
export_stl = ExportSTL(
    Mesh=mesh_brep_2,
    Relocate=Toggle(True),
    SavePath=ghpython_script_2.a,
    SaveAsBinaryFile=Toggle(True),
    SaveNow=Toggle(True),
    LastSaveLocalization="neutral,N")
is_mesh_closed = IsMeshClosed(Mesh=mesh_brep_2)

# ---- group: Writer
bounding_box = BoundingBox(Content=mesh_brep_2, Plane=PlaneXY(0, 0, 0))  # -> Box, Box_2
box_corners = BoxCorners(Box=bounding_box.Box)  # -> CornerA, CornerB, CornerC, CornerD, CornerE, CornerF, CornerG, CornerH
volume_4 = Volume(Geometry=mesh_brep_2)  # -> Volume, Centroid
line_4 = Line(StartPoint=box_corners.CornerA, EndPoint=box_corners.CornerB)
vector_length = VectorLength(Vector=line_4)
panel_3 = Panel("D:\Rocky_Simulations\Rocky AP-")
boolean_toggle_3 = BooleanToggle(True)
ghpython_script_3 = GhPythonScript(x=panel_3, z="\Geometrien\Carrier\", y="6.8.3", u="\", v="Carrier_Parameter.xlsx")  # -> out, a
# ---------- ghpython_script_3: Python ----------
__author__ = "sunpa675"
__version__ = "2024.07.22"

import rhinoscriptsyntax as rs


a = x + y + z + u + v
# ---------- end ghpython_script_3 ----------
open_workbook_2 = OpenWorkbook(Filepath=ghpython_script_3.a, Activate=boolean_toggle)
deconstruct_workbook_2 = DeconstructWorkbook(Workbook=open_workbook_2)  # -> Workbook, Worksheet
deconstruct_worksheet_2 = DeconstructWorksheet(Worksheet=deconstruct_workbook_2.Worksheet)  # -> Worksheet, Range, Cell
addition_3 = Addition(A=number_slider, B=Slider(1, range=0..1))
ghpython_script_4 = GhPythonScript(x=number_slider)  # -> out, a
# ---------- ghpython_script_4: Python ----------
__author__ = "sunpa675"
__version__ = "2024.07.22"

import rhinoscriptsyntax as rs
x = int(x)
a = 'C' + str(int(x+1))
# ---------- end ghpython_script_4 ----------
ghpython_script_5 = GhPythonScript(x=number_slider)  # -> out, a
# ---------- ghpython_script_5: Python ----------
__author__ = "sunpa675"
__version__ = "2024.07.22"

import rhinoscriptsyntax as rs
x = int(x)
a = 'A' + str(int(x+1))
# ---------- end ghpython_script_5 ----------
ghpython_script_6 = GhPythonScript(x=number_slider)  # -> out, a
# ---------- ghpython_script_6: Python ----------
__author__ = "sunpa675"
__version__ = "2024.07.22"

import rhinoscriptsyntax as rs

a = 'B' + str(int(int(x)+1))
# ---------- end ghpython_script_6 ----------
ghpython_script_7 = GhPythonScript(x=panel_3, y="6.8.3", z="\Geometrien\Carrier\")  # -> out, a
# ---------- ghpython_script_7: Python ----------
__author__ = "sunpa675"
__version__ = "2024.07.22"

import rhinoscriptsyntax as rs

a = x + y + z
# ---------- end ghpython_script_7 ----------
cell_content_7 = CellContent(CellLocation=ghpython_script_5.a, Value=number_slider)  # -> Cell, Location, Value, Format, Formula
cell_content_8 = CellContent(CellLocation=ghpython_script_4.a, Value=vector_length)  # -> Cell, Location, Value, Format, Formula
cell_content_9 = CellContent(CellLocation=ghpython_script_6.a, Value=volume_4.Volume)  # -> Cell, Location, Value, Format, Formula
merge_2 = Merge(Data1=cell_content_9.Cell, Data2=cell_content_7.Cell, Data3=cell_content_8.Cell)
panel_4 = Panel(ghpython_script_7.a)
construct_range = ConstructRange(Cells=flatten(merge_2))
construct_worksheet = ConstructWorksheet(Worksheet=deconstruct_worksheet_2.Worksheet, Range=construct_range)
boolean_toggle_4 = BooleanToggle(True)
construct_workbook = ConstructWorkbook(Worksheet=construct_worksheet)
save_workbook = SaveWorkbook(
    Workbook=construct_workbook,
    FolderPath=panel_4,
    FileName="Carrier_Parameter.xlsx",
    Extensions=0,
    Activate=boolean_toggle)  # -> Workbook, FilePath

# ---- group: Recent Geometry
ghpython_script_8 = GhPythonScript(x="6.8.3")  # -> out, a; same code as ghpython_script
open_workbook_3 = OpenWorkbook(Filepath=ghpython_script_8.a, Activate=boolean_toggle)
deconstruct_workbook_3 = DeconstructWorkbook(Workbook=open_workbook_3)  # -> Workbook, Worksheet
list_item_14 = ListItem(List=deconstruct_workbook_3.Worksheet, Index=0, Wrap=True)
deconstruct_worksheet_3 = DeconstructWorksheet(Worksheet=list_item_14)  # -> Worksheet, Range, Cell
sub_ranges_2 = SubRanges(Range=deconstruct_worksheet_3.Range, ByColumn=Toggle(False))
list_item_15 = ListItem(List=sub_ranges_2, Index=0, Wrap=True)
deconstruct_range_7 = DeconstructRange(Range=list_item_15, Active=False, Flip=True)  # -> Range, Cell, Address
panel_5 = Panel(number_slider)
list_item_16 = ListItem(List=deconstruct_range_7.Cell, Index=Slider(-1, range=-2..100), Wrap=True)
cell_content_10 = CellContent(Cell=list_item_16)  # -> Cell, Location, Value, Format, Formula
