# Grasshopper definition Rollingknot.gh (Grasshopper 1.0.8)
# plug-ins: Pufferfish, ExcelPlus, Pancake

# ---- group: Reload Excel
trigger = Trigger(Interval=1000, TimerInterval=1000, Target=python_3_script)
python_3_script = Python3Script()  # -> out, a
# ---------- python_3_script: Python ----------
import datetime
a = datetime.datetime.now().time()
total_seconds = a.hour * 3600 + a.minute * 60 + a.second + a.microsecond/1e6
a = total_seconds
# ---------- end python_3_script ----------
modulus = Modulus(A=python_3_script.a, B=Slider(65, range=0..100))
smaller_than = SmallerThan(FirstNumber=modulus, SecondNumber=Slider(5, range=0..10))  # -> SmallerThan, OrEqualTo
panel = Panel(smaller_than.SmallerThan)

# ----
boolean_toggle = BooleanToggle(True)

# ---- group: Recent Geometry
ghpython_script = GhPythonScript(x="6.8.1")  # -> out, a
# ---------- ghpython_script: Python ----------
__author__ = "sunpa675"
__version__ = "2024.05.06"

import rhinoscriptsyntax as rs
if x:
    #a = 'D:\Rocky AP-6.2.2\DoE\DoE_Arrays.xlsx'
    a = 'D:\Rocky_Simulations\Rocky AP-' + str(x) + '\DoE\DoE_Arrays.xlsx'
# ---------- end ghpython_script ----------
open_workbook = OpenWorkbook(Filepath=ghpython_script.a, Activate=smaller_than.SmallerThan)
deconstruct_workbook = DeconstructWorkbook(Workbook=open_workbook)  # -> Workbook, Worksheet
list_item = ListItem(List=deconstruct_workbook.Worksheet, Index=0, Wrap=True)
deconstruct_worksheet = DeconstructWorksheet(Worksheet=list_item)  # -> Worksheet, Range, Cell
sub_ranges = SubRanges(Range=deconstruct_worksheet.Range, ByColumn=Toggle(False))
list_item_2 = ListItem(List=sub_ranges, Index=0, Wrap=True)
deconstruct_range = DeconstructRange(Range=list_item_2, Active=False, Flip=True)  # -> Range, Cell, Address
list_item_3 = ListItem(List=deconstruct_range.Cell, Index=Slider(-1, range=-2..100), Wrap=True)
cell_content = CellContent(Cell=list_item_3)  # -> Cell, Location, Value, Format, Formula
panel_2 = Panel(cell_content.Value)

# ----
boolean_toggle_2 = BooleanToggle(True)
ghpython_script_2 = GhPythonScript(x="6.8.1")  # -> out, a; same code as ghpython_script
open_workbook_2 = OpenWorkbook(Filepath=ghpython_script_2.a, Activate=smaller_than.SmallerThan)
deconstruct_workbook_2 = DeconstructWorkbook(Workbook=open_workbook_2)  # -> Workbook, Worksheet
list_item_4 = ListItem(List=deconstruct_workbook_2.Worksheet, Index=0, Wrap=True)
deconstruct_worksheet_2 = DeconstructWorksheet(Worksheet=list_item_4)  # -> Worksheet, Range, Cell
value_list = ValueList({"Hexa Steg D": "1", "C": "2", "Hexa Pore D": "3", "Hexa Pore Z": "4", "Penta Steg D": "5", "Penta Steg Z": "6", "Penta Spike D": "7", "Penta Spike Z": "8", "Penta Tip Z": "9"}, selected="C")
value_list_2 = ValueList({"B": "1", "Hexa Steg Z": "2", "Hexa Pore D": "3", "Hexa Pore Z": "4", "Penta Steg D": "5", "Penta Steg Z": "6", "Penta Spike D": "7", "Penta Spike Z": "8", "Penta Tip Z": "9"}, selected="B")
value_list_3 = ValueList({"B": "1", "C": "2", "D": "3", "E": "4", "F": "5", "G": "6", "H": "7", "I": "8", "J": "9"}, selected="D")
value_list_4 = ValueList({"B": "1", "C": "2", "D": "3", "E": "4", "F": "5", "G": "6", "H": "7", "I": "8", "J": "9"}, selected="F")
value_list_5 = ValueList({"B": "1", "C": "2", "D": "3", "E": "4", "F": "5", "G": "6", "H": "7", "I": "8", "J": "9"}, selected="E")
sub_ranges_2 = SubRanges(Range=deconstruct_worksheet_2.Range, ByColumn=False)
list_item_5 = ListItem(List=sub_ranges_2, Index=Slider(0, range=0..100), Wrap=True)
deconstruct_range_2 = DeconstructRange(Range=list_item_5, Active=False, Flip=True)  # -> Range, Cell, Address
list_item_6 = ListItem(List=deconstruct_range_2.Cell, Index=Slider(1, range=0..10), Wrap=True)
cell_content_2 = CellContent(Cell=list_item_6)  # -> Cell, Location, Value, Format, Formula
list_item_7 = ListItem(List=sub_ranges_2, Index=value_list_2, Wrap=True)
list_item_8 = ListItem(List=sub_ranges_2, Index=value_list, Wrap=True)
list_item_9 = ListItem(List=sub_ranges_2, Index=value_list_3, Wrap=True)
list_item_10 = ListItem(List=sub_ranges_2, Index=value_list_4, Wrap=True)
list_item_11 = ListItem(List=sub_ranges_2, Index=value_list_5, Wrap=True)
deconstruct_range_3 = DeconstructRange(Range=list_item_9, Active=False, Flip=True)  # -> Range, Cell, Address
deconstruct_range_4 = DeconstructRange(Range=list_item_10, Active=False, Flip=True)  # -> Range, Cell, Address
deconstruct_range_5 = DeconstructRange(Range=list_item_7, Active=False, Flip=True)  # -> Range, Cell, Address
deconstruct_range_6 = DeconstructRange(Range=list_item_11, Active=False, Flip=True)  # -> Range, Cell, Address
deconstruct_range_7 = DeconstructRange(Range=list_item_8, Active=False, Flip=True)  # -> Range, Cell, Address
list_item_12 = ListItem(List=deconstruct_range_5.Cell, Index=cell_content.Value, Wrap=True)
list_item_13 = ListItem(List=deconstruct_range_7.Cell, Index=cell_content.Value, Wrap=True)
list_item_14 = ListItem(List=deconstruct_range_3.Cell, Index=cell_content.Value, Wrap=True)
list_item_15 = ListItem(List=deconstruct_range_4.Cell, Index=cell_content.Value, Wrap=True)
list_item_16 = ListItem(List=deconstruct_range_6.Cell, Index=cell_content.Value, Wrap=True)
cell_content_3 = CellContent(Cell=list_item_12)  # -> Cell, Location, Value, Format, Formula
cell_content_4 = CellContent(Cell=list_item_13)  # -> Cell, Location, Value, Format, Formula
cell_content_5 = CellContent(Cell=list_item_14)  # -> Cell, Location, Value, Format, Formula
cell_content_6 = CellContent(Cell=list_item_15)  # -> Cell, Location, Value, Format, Formula
cell_content_7 = CellContent(Cell=list_item_16)  # -> Cell, Location, Value, Format, Formula

# ---- group: Geometry
float_a_ini_0_8 = Slider(0.8, range=0..1)
point_count_ini_360 = Slider(360, range=0..360)
scale = Slider(23, range=1..100)
float_c_ini_1_8 = Slider(1.8, range=0..4)
int_p_ini_3 = Slider(3, range=0..10)
int_q_ini_2 = Slider(2, range=0..10)
expression = Expression(x=float_a_ini_0_8, Expression="Sqrt (1 - x * x)")
python = GhPythonScript(a=float_a_ini_0_8, b=expression, c=cell_content_5.Value, p=int_p_ini_3, q=int_q_ini_2, t=point_count_ini_360)  # -> r
# ---------- python: Python ----------
__author__ = "Fablab"
__version__ = "2020.12.04"

import rhinoscriptsyntax as rs
import math

r = []
c = float(c)
for i in range(int(t)):
    r.append(rs.AddPoint(a * math.cos(p * i)/(1 -b * math.sin(q * i)),a * math.sin(p * i)/(1 - b * math.sin (q * i)),c * b * math.cos(q *i) / (1 - b * math.sin (q * i))))
 
"""r.append(r[0])"""
# ---------- end python ----------
scale_2 = Scale(Geometry=python, Center=Point(0, 0, 0), Factor=scale)  # -> Geometry, Transform
scp = SequentialClosestPoints(S=scale_2.Geometry)  # -> A, I; inputs P: Point3d, S: list of Point3d
# ---------- scp: VB ----------
    Component.Params.Input(0).Name = "Sample Point"
    Component.Params.Input(0).Description = "The point to start from"
    Component.Params.Input(1).Name = "Sample Point List"
    Component.Params.Input(1).Description = "The list of points to be sequentially sampled"

    Component.Params.Output(0).Name = "Point List"
    Component.Params.Output(0).Description = "The sorted list of points"
    Component.Params.Output(1).Name = "Indices"
    Component.Params.Output(1).Description = "The parallel sorted list of indices"

    Dim k,j As Integer
    Dim pt As point3d
    Dim pts As New point3dList
    Dim ptList As New list(Of point3d)
    Dim srsEnum As IEnumerable(Of Integer) = Enumerable.Range(0, S.count())
    Dim srsList As New list (Of Integer)
    Dim intList As New list(Of Integer)
    pts.AddRange(S.toarray())

    Pt = P

    srsList = srsEnum.tolist()

    For k = 0 To pts.Count() - 1 Step 1
      j = pts.ClosestIndex(pt)
      ptList.add(pts.item(j))
      intList.add(srsList.item(j))
      pt = pts.item(j)
      pts.RemoveAt(j)
      srsList.RemoveAt(j)
    Next

    A = ptList
    I = intList
# ---------- end scp ----------
points = PointList(Points=scp.A, Size=Slider(0.662, range=0..1))  # disabled
intcrv = Interpolate(Vertices=scp.A, Degree=3, Periodic=False, KnotStyle=1)  # -> Curve, Length, Domain
connect = ConnectCurves(Curves=intcrv.Curve, Continuity=2, Close=True, Bulge=1)
crv = Curve(reparameterize(connect))
radius_curve = Slider(8, range=3..25)
kanten = Slider(8, range=4..30)
divide_curve = DivideCurve(Curve=crv, Count=Slider(360, range=0..360), Kinks=False)  # -> Points, Tangents, Parameters
vector = Vector(divide_curve.Tangents)
construct_point = ConstructPoint(XCoordinate=0, YCoordinate=0, ZCoordinate=0)
polygon = Polygon(Plane=PlaneXY(0, 0, 0), Radius=cell_content_3.Value, Segments=cell_content_4.Value, FilletRadius=0)  # -> Polygon, Length
move_to_point = MoveToPoint(Geometry=polygon.Polygon, PointA=construct_point, PointB=divide_curve.Points)  # -> Moved, Vector, Transform
vector_2 = Vector(move_to_point.Vector)
unit_vector = UnitVector(Vector=vector_2)
move = Move(Geometry=divide_curve.Points, Motion=unit_vector)  # -> Geometry, Transform
curve_closest_point = CurveClosestPoint(Point=move.Geometry, Curve=crv)  # -> Point, Parameter, Distance
line = Line(StartPoint=move.Geometry, EndPoint=curve_closest_point.Point)
move_2 = Move(Geometry=divide_curve.Points, Motion=vector)  # -> Geometry, Transform
vector_3 = Vector(line)
line_2 = Line(StartPoint=move_2.Geometry, EndPoint=divide_curve.Points)
vector_4 = Vector(line_2)
rotate = Rotate(Vector=vector_3, Axis=vector_4, Angle=Slider(1, range=0..1))
move_3 = Move(Geometry=divide_curve.Points, Motion=rotate)  # -> Geometry, Transform
line_3 = Line(StartPoint=move_3.Geometry, EndPoint=divide_curve.Points)
vector_5 = Vector(line_3)
construct_plane = ConstructPlane(Origin=divide_curve.Points, XAxis=vector_3, YAxis=vector_5)
polygon_2 = Polygon(Plane=construct_plane, Radius=cell_content_3.Value, Segments=cell_content_4.Value, FilletRadius=0)  # -> Polygon, Length
number_slider = Slider(-1, range=-1..1)
list_item_17 = ListItem(List=polygon_2.Polygon, Index=number_slider, Wrap=True)
list_item_18 = ListItem(List=polygon_2.Polygon, Index=0, Wrap=True)
merge = Merge(Data1=list_item_18, Data2=list_item_17)
insert_items = InsertItems(List=polygon_2.Polygon, Item=list_item_18, Indices=number_slider, Wrap=True)
loft = Loft(Curves=merge, Options={Adjust=False, Closed=False, LoftEnds=0, LoftSimp=0, LoftType=0, Rebuild=10, Refit=0.01})
loft_2 = Loft(
    Curves=polygon_2.Polygon,
    Options={Adjust=False, Closed=False, LoftEnds=0, LoftSimp=0, LoftType=0, Rebuild=10, Refit=0.01})
merge_2 = Merge(Data1=loft_2, Data2=loft)
brep_join = BrepJoin(Breps=merge_2)  # -> Breps, Closed
merge_3 = Merge(Data3=brep_join.Breps)
brep_join_2 = BrepJoin(Breps=flatten(merge_3))  # -> Breps, Closed
solid_union = SolidUnion(Breps=brep_join_2.Breps)
is_mesh_closed = IsMeshClosed(Mesh=solid_union)
panel_3 = Panel(is_mesh_closed)

# ---- group: Export
brep_geometry = Brep(solid_union)
ghpython_script_3 = GhPythonScript(z=cell_content_2.Value, x="6.8.1", y=cell_content.Value)  # -> out, a
# ---------- ghpython_script_3: Python ----------
__author__ = "sunpa675"
__version__ = "2024.03.14"

import Rhino as rc
a = 'D:\Rocky_Simulations\Rocky AP-' + str(x) + '\Geometrien\Carrier\\' + str(int(y)) + '.stl'
# ---------- end ghpython_script_3 ----------
settings_custom = SettingsCustom(
    StitchSeams=True,
    SimplePlanes=False,
    Refine=True,
    MinCount=Slider(0, range=0..100),
    MaxCount=Slider(22, range=0..100),
    AspectRatio=20,
    MaxDistance=0,
    MaxAngle=20,
    MinEdge=Slider(0, range=0..100),
    MaxEdge=0)
mesh_brep = MeshBrep(Brep=brep_geometry, Settings=settings_custom)
export_stl = ExportSTL(
    Mesh=mesh_brep,
    Relocate=Toggle(True),
    SavePath=ghpython_script_3.a,
    SaveAsBinaryFile=Toggle(True),
    SaveNow=Toggle(True),
    LastSaveLocalization="neutral,N")
is_mesh_closed_2 = IsMeshClosed(Mesh=mesh_brep)

# ---- group: Writer
bounding_box = BoundingBox(Content=mesh_brep, Plane=PlaneXY(0, 0, 0))  # -> Box, Box_2
box_corners = BoxCorners(Box=bounding_box.Box)  # -> CornerA, CornerB, CornerC, CornerD, CornerE, CornerF, CornerG, CornerH
volume = Volume(Geometry=mesh_brep)  # -> Volume, Centroid
line_4 = Line(StartPoint=box_corners.CornerA, EndPoint=box_corners.CornerB)
vector_length = VectorLength(Vector=line_4)
panel_4 = Panel("D:\Rocky_Simulations\Rocky AP-")
boolean_toggle_3 = BooleanToggle(True)
ghpython_script_4 = GhPythonScript(x=panel_4, z="\Geometrien\Carrier\", y="6.8.1", u="\", v="Carrier_Parameter.xlsx")  # -> out, a
# ---------- ghpython_script_4: Python ----------
__author__ = "sunpa675"
__version__ = "2024.07.22"

import rhinoscriptsyntax as rs


a = x + y + z + u + v
# ---------- end ghpython_script_4 ----------
open_workbook_3 = OpenWorkbook(Filepath=ghpython_script_4.a, Activate=smaller_than.SmallerThan)
deconstruct_workbook_3 = DeconstructWorkbook(Workbook=open_workbook_3)  # -> Workbook, Worksheet
deconstruct_worksheet_3 = DeconstructWorksheet(Worksheet=deconstruct_workbook_3.Worksheet)  # -> Worksheet, Range, Cell
addition = Addition(A=cell_content.Value, B=Slider(1, range=0..1))
ghpython_script_5 = GhPythonScript(x=cell_content.Value)  # -> out, a
# ---------- ghpython_script_5: Python ----------
__author__ = "sunpa675"
__version__ = "2024.07.22"

import rhinoscriptsyntax as rs
x = int(x)
a = 'C' + str(int(x+1))
# ---------- end ghpython_script_5 ----------
ghpython_script_6 = GhPythonScript(x=cell_content.Value)  # -> out, a
# ---------- ghpython_script_6: Python ----------
__author__ = "sunpa675"
__version__ = "2024.07.22"

import rhinoscriptsyntax as rs
x = int(x)
a = 'A' + str(int(x+1))
# ---------- end ghpython_script_6 ----------
ghpython_script_7 = GhPythonScript(x=cell_content.Value)  # -> out, a
# ---------- ghpython_script_7: Python ----------
__author__ = "sunpa675"
__version__ = "2024.07.22"

import rhinoscriptsyntax as rs

a = 'B' + str(int(int(x)+1))
# ---------- end ghpython_script_7 ----------
ghpython_script_8 = GhPythonScript(x=panel_4, y="6.8.1", z="\Geometrien\Carrier\")  # -> out, a
# ---------- ghpython_script_8: Python ----------
__author__ = "sunpa675"
__version__ = "2024.07.22"

import rhinoscriptsyntax as rs

a = x + y + z
# ---------- end ghpython_script_8 ----------
cell_content_8 = CellContent(CellLocation=ghpython_script_6.a, Value=cell_content.Value)  # -> Cell, Location, Value, Format, Formula
cell_content_9 = CellContent(CellLocation=ghpython_script_5.a, Value=vector_length)  # -> Cell, Location, Value, Format, Formula
cell_content_10 = CellContent(CellLocation=ghpython_script_7.a, Value=volume.Volume)  # -> Cell, Location, Value, Format, Formula
merge_4 = Merge(Data1=cell_content_10.Cell, Data2=cell_content_8.Cell, Data3=cell_content_9.Cell)
panel_5 = Panel(ghpython_script_8.a)
construct_range = ConstructRange(Cells=flatten(merge_4))
construct_worksheet = ConstructWorksheet(Worksheet=deconstruct_worksheet_3.Worksheet, Range=construct_range)
boolean_toggle_4 = BooleanToggle(True)
construct_workbook = ConstructWorkbook(Worksheet=construct_worksheet)
save_workbook = SaveWorkbook(
    Workbook=construct_workbook,
    FolderPath=panel_5,
    FileName="Carrier_Parameter.xlsx",
    Extensions=0,
    Activate=smaller_than.SmallerThan)  # -> Workbook, FilePath

# ----
panel_6 = Panel("D:\Rocky_Simulations\Rocky AP-6.8.1\DoE\DoE_Arrays.xlsx")
number_slider_2 = Slider(1, range=0..10)
