# Grasshopper definition SoccerCone.gh (Grasshopper 1.0.8)
# plug-ins: Pufferfish, GhPolyhedra, ExcelPlus, Pancake

text = Text("Truncated Icosahedron")
polyhedron = Polyhedron(Name=text, Plane=PlaneXY(0, 0, 0), Scale=1)  # -> Curves, Meshes, Solid

# ---- group: Reload Excel
trigger = Trigger(Interval=1000, TimerInterval=1000, Target=python_3_script)
python_3_script = Python3Script()  # -> out, a
# ---------- python_3_script: Python ----------
import datetime
a = datetime.datetime.now().time()
total_seconds = a.hour * 3600 + a.minute * 60 + a.second + a.microsecond/1e6
a = total_seconds
# ---------- end python_3_script ----------
modulus = Modulus(A=python_3_script.a, B=Slider(65, range=0..100))
smaller_than = SmallerThan(FirstNumber=modulus, SecondNumber=Slider(5, range=0..10))  # -> SmallerThan, OrEqualTo
panel = Panel(smaller_than.SmallerThan)

# ----
boolean_toggle = BooleanToggle(True)

# ---- group: Recent Geometry
ghpython_script = GhPythonScript(x="6.8.2")  # -> out, a
# ---------- ghpython_script: Python ----------
__author__ = "sunpa675"
__version__ = "2024.05.06"

import rhinoscriptsyntax as rs
if x:
    #a = 'D:\Rocky AP-6.2.2\DoE\DoE_Arrays.xlsx'
    a = 'D:\Rocky_Simulations\Rocky AP-' + str(x) + '\DoE\DoE_Arrays.xlsx'
# ---------- end ghpython_script ----------
open_workbook = OpenWorkbook(Filepath=ghpython_script.a, Activate=smaller_than.SmallerThan)
deconstruct_workbook = DeconstructWorkbook(Workbook=open_workbook)  # -> Workbook, Worksheet
list_item = ListItem(List=deconstruct_workbook.Worksheet, Index=0, Wrap=True)
deconstruct_worksheet = DeconstructWorksheet(Worksheet=list_item)  # -> Worksheet, Range, Cell
sub_ranges = SubRanges(Range=deconstruct_worksheet.Range, ByColumn=Toggle(False))
list_item_2 = ListItem(List=sub_ranges, Index=0, Wrap=True)
deconstruct_range = DeconstructRange(Range=list_item_2, Active=False, Flip=True)  # -> Range, Cell, Address
list_item_3 = ListItem(List=deconstruct_range.Cell, Index=Slider(-1, range=-2..100), Wrap=True)
cell_content = CellContent(Cell=list_item_3)  # -> Cell, Location, Value, Format, Formula
panel_2 = Panel(cell_content.Value)

# ----
boolean_toggle_2 = BooleanToggle(True)
ghpython_script_2 = GhPythonScript(x="6.8.2")  # -> out, a; same code as ghpython_script
open_workbook_2 = OpenWorkbook(Filepath=ghpython_script_2.a, Activate=smaller_than.SmallerThan)
deconstruct_workbook_2 = DeconstructWorkbook(Workbook=open_workbook_2)  # -> Workbook, Worksheet
list_item_4 = ListItem(List=deconstruct_workbook_2.Worksheet, Index=0, Wrap=True)
deconstruct_worksheet_2 = DeconstructWorksheet(Worksheet=list_item_4)  # -> Worksheet, Range, Cell
value_list = ValueList({"Hexa Steg D": "1", "C": "2", "Hexa Pore D": "3", "Hexa Pore Z": "4", "Penta Steg D": "5", "Penta Steg Z": "6", "Penta Spike D": "7", "Penta Spike Z": "8", "Penta Tip Z": "9"}, selected="C")
value_list_2 = ValueList({"B": "1", "Hexa Steg Z": "2", "Hexa Pore D": "3", "Hexa Pore Z": "4", "Penta Steg D": "5", "Penta Steg Z": "6", "Penta Spike D": "7", "Penta Spike Z": "8", "Penta Tip Z": "9"}, selected="B")
value_list_3 = ValueList({"B": "1", "C": "2", "D": "3", "E": "4", "F": "5", "G": "6", "H": "7", "I": "8", "J": "9"}, selected="D")
value_list_4 = ValueList({"B": "1", "C": "2", "D": "3", "E": "4", "F": "5", "G": "6", "H": "7", "I": "8", "J": "9"}, selected="F")
value_list_5 = ValueList({"B": "1", "C": "2", "D": "3", "E": "4", "F": "5", "G": "6", "H": "7", "I": "8", "J": "9"}, selected="E")
sub_ranges_2 = SubRanges(Range=deconstruct_worksheet_2.Range, ByColumn=False)
list_item_5 = ListItem(List=sub_ranges_2, Index=Slider(0, range=0..100), Wrap=True)
deconstruct_range_2 = DeconstructRange(Range=list_item_5, Active=False, Flip=True)  # -> Range, Cell, Address
list_item_6 = ListItem(List=deconstruct_range_2.Cell, Index=Slider(1, range=0..10), Wrap=True)
cell_content_2 = CellContent(Cell=list_item_6)  # -> Cell, Location, Value, Format, Formula
list_item_7 = ListItem(List=sub_ranges_2, Index=value_list_2, Wrap=True)
list_item_8 = ListItem(List=sub_ranges_2, Index=value_list, Wrap=True)
list_item_9 = ListItem(List=sub_ranges_2, Index=value_list_3, Wrap=True)
list_item_10 = ListItem(List=sub_ranges_2, Index=value_list_4, Wrap=True)
list_item_11 = ListItem(List=sub_ranges_2, Index=value_list_5, Wrap=True)
deconstruct_range_3 = DeconstructRange(Range=list_item_9, Active=False, Flip=True)  # -> Range, Cell, Address
deconstruct_range_4 = DeconstructRange(Range=list_item_10, Active=False, Flip=True)  # -> Range, Cell, Address
deconstruct_range_5 = DeconstructRange(Range=list_item_7, Active=False, Flip=True)  # -> Range, Cell, Address
deconstruct_range_6 = DeconstructRange(Range=list_item_11, Active=False, Flip=True)  # -> Range, Cell, Address
deconstruct_range_7 = DeconstructRange(Range=list_item_8, Active=False, Flip=True)  # -> Range, Cell, Address
list_item_12 = ListItem(List=deconstruct_range_5.Cell, Index=cell_content.Value, Wrap=True)
list_item_13 = ListItem(List=deconstruct_range_7.Cell, Index=cell_content.Value, Wrap=True)
list_item_14 = ListItem(List=deconstruct_range_3.Cell, Index=cell_content.Value, Wrap=True)
list_item_15 = ListItem(List=deconstruct_range_4.Cell, Index=cell_content.Value, Wrap=True)
list_item_16 = ListItem(List=deconstruct_range_6.Cell, Index=cell_content.Value, Wrap=True)
cell_content_3 = CellContent(Cell=list_item_12)  # -> Cell, Location, flatten(Value), Format, Formula
cell_content_4 = CellContent(Cell=list_item_13)  # -> Cell, Location, flatten(Value), Format, Formula
cell_content_5 = CellContent(Cell=list_item_14)  # -> Cell, Location, flatten(Value), Format, Formula
cell_content_6 = CellContent(Cell=list_item_15)  # -> Cell, Location, Value, Format, Formula
cell_content_7 = CellContent(Cell=list_item_16)  # -> Cell, Location, flatten(Value), Format, Formula

depth = Slider(0.125, range=0.01..0.25)
height = Slider(1.1, range=0.1..1.1)
spike = Slider(1, range=0.01..1)
plateau = Slider(0.25, range=0.01..1)
split_list = SplitList(List=polyhedron.Curves, Index=Slider(20, range=0..100))  # -> ListA, ListB
curve = Curve(split_list.ListA)
curve_2 = Curve(split_list.ListB)
number_slider = Slider(0, range=0..100)
number_slider_2 = Slider(0, range=0..100)
area = Area(Geometry=curve)  # -> Area, Centroid
construct_point = ConstructPoint(XCoordinate=number_slider, YCoordinate=number_slider, ZCoordinate=number_slider)
area_2 = Area(Geometry=curve_2)  # -> Area, Centroid
construct_point_2 = ConstructPoint(XCoordinate=number_slider_2, YCoordinate=number_slider_2, ZCoordinate=number_slider_2)
scale = Scale(Geometry=curve, Center=area.Centroid, Factor=cell_content_4.Value)  # -> Geometry, Transform
vector_2pt = Vector2Pt(PointA=construct_point, PointB=area.Centroid, Unitize=False)  # -> Vector, Length
scale_2 = Scale(Geometry=curve_2, Center=area_2.Centroid, Factor=cell_content_7.Value)  # -> Geometry, Transform
vector_2pt_2 = Vector2Pt(PointA=construct_point_2, PointB=area_2.Centroid, Unitize=False)  # -> Vector, Length
multiplication = Multiplication(A=Slider(-1, range=-1..100), B=vector_2pt.Vector)
multiplication_2 = Multiplication(A=vector_2pt_2.Vector, B=cell_content_5.Value)
multiplication_3 = Multiplication(A=multiplication, B=cell_content_3.Value)
move = Move(Geometry=scale.Geometry, Motion=multiplication_3)  # -> Geometry, Transform
move_2 = Move(Geometry=scale_2.Geometry, Motion=multiplication_2)  # -> Geometry, Transform
merge = Merge(Data1=graft(curve), Data2=graft(move.Geometry))
merge_2 = Merge(Data1=graft(curve_2), Data2=graft(move_2.Geometry))
loft = Loft(Curves=merge, Options={Adjust=False, Closed=False, LoftEnds=0, LoftSimp=0, LoftType=0, Rebuild=10, Refit=0.01})
loft_2 = Loft(Curves=merge_2, Options={Adjust=False, Closed=False, LoftEnds=0, LoftSimp=0, LoftType=0, Rebuild=10, Refit=0.01})
cap_holes = CapHoles(Brep=loft)
cap_holes_2 = CapHoles(Brep=loft_2)
brep_join = BrepJoin(Breps=polyhedron.Curves)  # -> Breps, Closed
brep_join_2 = BrepJoin(Breps=cap_holes_2)  # -> Breps, Closed
merge_3 = Merge(Data1=brep_join.Breps, Data2=cap_holes_2)
merge_4 = Merge(Data1=cap_holes, Data2=cap_holes_2)
solid_union = SolidUnion(Breps=flatten(merge_3))
brep_join_3 = BrepJoin(Breps=merge_4)  # -> Breps, Closed
list_item_17 = ListItem(List=flatten(cap_holes), Index=0, Wrap=True)
solid_difference = SolidDifference(BrepsA=solid_union, BrepsB=flatten(cap_holes))

# ---- group: Export
brep_geometry = Brep(solid_difference)
ghpython_script_3 = GhPythonScript(z=cell_content_2.Value, x="6.8.2", y=cell_content.Value)  # -> out, a
# ---------- ghpython_script_3: Python ----------
__author__ = "sunpa675"
__version__ = "2024.03.14"

import Rhino as rc
a = 'D:\Rocky_Simulations\Rocky AP-' + str(x) + '\Geometrien\Carrier\\' + str(int(y)) + '.stl'
# ---------- end ghpython_script_3 ----------
settings_custom = SettingsCustom(
    StitchSeams=True,
    SimplePlanes=False,
    Refine=True,
    MinCount=Slider(0, range=0..100),
    MaxCount=Slider(22, range=0..100),
    AspectRatio=20,
    MaxDistance=0,
    MaxAngle=20,
    MinEdge=Slider(0, range=0..100),
    MaxEdge=0)
mesh_brep = MeshBrep(Brep=brep_geometry, Settings=settings_custom)
export_stl = ExportSTL(
    Mesh=mesh_brep,
    Relocate=Toggle(True),
    SavePath=ghpython_script_3.a,
    SaveAsBinaryFile=Toggle(True),
    SaveNow=Toggle(True),
    LastSaveLocalization="neutral,N")
is_mesh_closed = IsMeshClosed(Mesh=mesh_brep)

# ---- group: Writer
bounding_box = BoundingBox(Content=mesh_brep, Plane=PlaneXY(0, 0, 0))  # -> Box, Box_2
box_corners = BoxCorners(Box=bounding_box.Box)  # -> CornerA, CornerB, CornerC, CornerD, CornerE, CornerF, CornerG, CornerH
volume = Volume(Geometry=mesh_brep)  # -> Volume, Centroid
line = Line(StartPoint=box_corners.CornerA, EndPoint=box_corners.CornerB)
vector_length = VectorLength(Vector=line)
panel_3 = Panel("D:\Rocky_Simulations\Rocky AP-")
boolean_toggle_3 = BooleanToggle(True)
ghpython_script_4 = GhPythonScript(x=panel_3, z="\Geometrien\Carrier\", y="6.8.2", u="\", v="Carrier_Parameter.xlsx")  # -> out, a
# ---------- ghpython_script_4: Python ----------
__author__ = "sunpa675"
__version__ = "2024.07.22"

import rhinoscriptsyntax as rs


a = x + y + z + u + v
# ---------- end ghpython_script_4 ----------
open_workbook_3 = OpenWorkbook(Filepath=ghpython_script_4.a, Activate=smaller_than.SmallerThan)
deconstruct_workbook_3 = DeconstructWorkbook(Workbook=open_workbook_3)  # -> Workbook, Worksheet
deconstruct_worksheet_3 = DeconstructWorksheet(Worksheet=deconstruct_workbook_3.Worksheet)  # -> Worksheet, Range, Cell
addition = Addition(A=cell_content.Value, B=Slider(1, range=0..1))
ghpython_script_5 = GhPythonScript(x=cell_content.Value)  # -> out, a
# ---------- ghpython_script_5: Python ----------
__author__ = "sunpa675"
__version__ = "2024.07.22"

import rhinoscriptsyntax as rs
x = int(x)
a = 'C' + str(int(x+1))
# ---------- end ghpython_script_5 ----------
ghpython_script_6 = GhPythonScript(x=cell_content.Value)  # -> out, a
# ---------- ghpython_script_6: Python ----------
__author__ = "sunpa675"
__version__ = "2024.07.22"

import rhinoscriptsyntax as rs
x = int(x)
a = 'A' + str(int(x+1))
# ---------- end ghpython_script_6 ----------
ghpython_script_7 = GhPythonScript(x=cell_content.Value)  # -> out, a
# ---------- ghpython_script_7: Python ----------
__author__ = "sunpa675"
__version__ = "2024.07.22"

import rhinoscriptsyntax as rs

a = 'B' + str(int(int(x)+1))
# ---------- end ghpython_script_7 ----------
ghpython_script_8 = GhPythonScript(x=panel_3, y="6.8.2", z="\Geometrien\Carrier\")  # -> out, a
# ---------- ghpython_script_8: Python ----------
__author__ = "sunpa675"
__version__ = "2024.07.22"

import rhinoscriptsyntax as rs

a = x + y + z
# ---------- end ghpython_script_8 ----------
cell_content_8 = CellContent(CellLocation=ghpython_script_6.a, Value=cell_content.Value)  # -> Cell, Location, Value, Format, Formula
cell_content_9 = CellContent(CellLocation=ghpython_script_5.a, Value=vector_length)  # -> Cell, Location, Value, Format, Formula
cell_content_10 = CellContent(CellLocation=ghpython_script_7.a, Value=volume.Volume)  # -> Cell, Location, Value, Format, Formula
merge_5 = Merge(Data1=cell_content_10.Cell, Data2=cell_content_8.Cell, Data3=cell_content_9.Cell)
panel_4 = Panel(ghpython_script_8.a)
construct_range = ConstructRange(Cells=flatten(merge_5))
construct_worksheet = ConstructWorksheet(Worksheet=deconstruct_worksheet_3.Worksheet, Range=construct_range)
boolean_toggle_4 = BooleanToggle(True)
construct_workbook = ConstructWorkbook(Worksheet=construct_worksheet)
save_workbook = SaveWorkbook(
    Workbook=construct_workbook,
    FolderPath=panel_4,
    FileName="Carrier_Parameter.xlsx",
    Extensions=0,
    Activate=smaller_than.SmallerThan)  # -> Workbook, FilePath

# ----
number_slider_3 = Slider(3, range=0..10)
